# Dynamo graph ML_test.dyn (Dynamo 2.1.0.7500)

directory_path = Directory("C:\Users\Jason\Documents\GitHub\theDAM\organization_logic\ML samples")
directory_from_path = DirectoryObject(path=directory_path)
getDirectoryContents = FileSystem.GetDirectoryContents(directory=directory_from_path)
readText = FileSystem.ReadText(file=getDirectoryContents.files)
code_block = CodeBlock()
# ---------- code_block.designscript (2 lines) ----------
"
";
# ----------------------------------------
split = String.Split(str=readText, separator0=code_block)
uniqueItems = List.UniqueItems(list=split@L2)
fileName = FileSystem.FileName(path=getDirectoryContents.files)
byKeysValues = DesignScript.Builtin.Dictionary.ByKeysValues(keys=uniqueItems, values=fileName)
directory_path_2 = Directory("C:\Users\Jason\Documents\GitHub\theDAM\organization_logic\ML samples")
directory_from_path_2 = DirectoryObject(path=directory_path_2)
getDirectoryContents_2 = FileSystem.GetDirectoryContents(directory=directory_from_path_2)
readText_2 = FileSystem.ReadText(file=getDirectoryContents_2.files)
code_block_2 = CodeBlock()  # same code as code_block
split_2 = String.Split(str=readText_2, separator0=code_block_2)
uniqueItems_2 = List.UniqueItems(list=split_2@L2)
fileName_2 = FileSystem.FileName(path=getDirectoryContents_2.files)
byKeysValues_2 = DesignScript.Builtin.Dictionary.ByKeysValues(keys=uniqueItems_2, values=fileName_2)
