# Dynamo graph QueriesRevit.dyn (Dynamo 2.1.0.7500)

current = dtDynamo.Workspace.Current()
groups = dtDynamo.Workspace.Groups(workspace=current)
nodes = dtDynamo.Group.Nodes(group=groups)
name = dtDynamo.Node.Name(node=nodes)
name_2 = dtDynamo.Workspace.Name(workspace=current)
